# Grasshopper definition [10-8-2019 6-16pm] Assignment 00 Live.gh (Grasshopper 1.0.7)
# plug-ins: ViveTrack

# ---- group: Set up the Vive tracker and read information from the controllers
startvive = StartVive(AutoUpdate=True)  # -> Msg, Vive
controller1 = Controller1(Vive=startvive.Vive, Pause=False)  # -> Controller, Plane, Matrix, TriggerState, TouchPadState
controller2 = Controller2(Vive=startvive.Vive, Pause=False)  # -> Controller, Plane, Matrix, TriggerState, TouchPadState

# ----
# #GSD6338
# Introduction to Computational Design
# Instructor: Jose Luis García del Castillo y López
# Harvard University Graduate School of Design
# HTC Vive Recorder
# This file contains a sample Grasshopper definition to record motion tracker information from an HTC Vive and save it to a CSV file.
# This file uses the ViveTrack plugin by Chen Jingcheng to read from the controller: https://github.com/ccc159/ViveTrack
# Authors: Daniel Tish, Beilei Ren and Jose Luis García del Castillo, 2019.
# 
# This file is part of a class assignment for GSD6338: Introduction to Computational Design.
# More info on: https://www.gsd.harvard.edu/course/introduction-to-computational-design-fall-2019/
# Lecture videos: http://bit.ly/GSD6338-Fall2019
panel = Panel("C:\Users\Ben\Desktop\Mirah\SCI 6338\Assignments\00\Mirah_01.csv")

# ---- group: Manually calibrate the output of the controllers
calibrateorigin = CalibrateOrigin(OriginPlane=controller1.Plane, Calibrate=Button(), Reset=Button())

# ---- group: Just for display
mesh = Mesh([controller1.Controller, controller2.Controller])

# ---- group: For each update of the Vive, generate a Unix timestamp
c_script = CSharpScript(data=controller1.Plane)  # -> out, timestamp
# ---------- c_script: C# ----------
    // This file generates a new UNIX timestamp any time new data is fed to it.

    // The Unix Epoch timestamp is the number of seconds (or milliseconds) that have elapsed
    // since Jan 1st 1970, and it is a very common way of storing time in computers.
    // https://en.wikipedia.org/wiki/Unix_time

    // It doesn't matter which data this component is fed, the data input is only used to monitor
    // changes in data input and trigger the generation of a new stamp; this technique is
    // commonly referred to as using data as a "ticker".

    // Code from: https://stackoverflow.com/a/17632585
    // We use long type because the largest number a 32-bit signed integer can store is 2147483647:
    // https://en.wikipedia.org/wiki/2,147,483,647
    long unixTimestamp = (long) DateTime.UtcNow.Subtract(new DateTime(1970, 1, 1)).TotalMilliseconds;

    // Output
    timestamp = unixTimestamp;
# ---------- end c_script ----------
panel_2 = Panel(c_script.timestamp)
c_script_2 = CSharpScript(timestamp=c_script.timestamp)  # -> out, humanReadable; inputs timestamp: String
# ---------- c_script_2: C# ----------
    // Grasshopper inputs cannot be set to longs; let's convert the string timestamp to long
    long ts = Convert.ToInt64(timestamp);
    
    // Let's convert it to seconds; notice how integer division here avoids decimal problems! 
    ts /= 1000;
    
    // Code from: https://stackoverflow.com/a/250400
    // Create a timestamp for Epoch (Jan 1st 1970)
    System.DateTime dtDateTime = new DateTime(1970, 1, 1, 0, 0, 0, 0, System.DateTimeKind.Utc);
    
    // Add the seconds elapsed since, and convert to human time representation
    humanReadable = dtDateTime.AddSeconds(ts).ToLocalTime();
# ---------- end c_script_2 ----------
panel_3 = Panel(c_script_2.humanReadable)

# ---- group: Structure the incoming data and manually record it
entwine = Entwine(
    Branch00=c_script.timestamp,
    Branch01=controller1.Plane,
    Branch02=controller1.TriggerState,
    Branch03=controller1.TouchPadState,
    Branch04=controller2.Plane,
    Branch05=controller2.TriggerState,
    Branch06=controller2.TouchPadState,
    FlattenInputs=True)
rec = DataRecorder(entwine, DataLimit=-10, RecordData=False)

# ----
list = ValueList({"None": 0, "Right": 1, "Left": 2, "Both": 3}, selected="Both")
list_2 = ValueList({"One": 1, "Two": 2}, selected="Two")
list_3 = ValueList({"One": 1, "Two": 2}, selected="Two")

# ---- group: Deserialize the datatree into its components and feed it to the CSV writer
data = Data(rec)
bang = ExplodeTree(Data=data)  # -> Branch0, Branch1, Branch2, Branch3, Branch4, Branch5, Branch6

# ----
c_script_3 = CSharpScript(
    pl1=bang.Branch1,
    trigger1=bang.Branch2,
    pad1=bang.Branch3,
    pl2=bang.Branch4,
    trigger2=bang.Branch5,
    pad2=bang.Branch6,
    minDistance=Slider(0.025, range=0..0.13),
    lineNum=list_2,
    showLine=list,
    scale=Slider(2, range=-5..5),
    controllerSelector=list_3,
    clickedSwitch=Slider(0, range=0..5))  # -> out, draws, triggerOnly, rightLines, leftLines, lofts; inputs pl1: list of Plane, trigger1: list of Double, pad1: list of Double, pl2: list of Plane, trigger2: list of Double, pad2: list of Double, minDistance: Double, lineNum: Int32, showLine: Int32, scale: Double, controllerSelector: Int32, clickedSwitch: Int32
# ---------- c_script_3: C# ----------
    List<Draw> drawValueList = new List<Draw>();
    List<Draw> triggeredList = new List<Draw>();

    int touchClicked = 0;

    int frames = pl1.Count;



    //while(Running){
    for(int i = 0; i < frames; i++){
      // Get indexes for the trigger and pad lists
      int trigIndex = i * 3;
      int padInd = i * 4;
      //Draw draw = new Draw();

      //Vanilla data
      Draw draw = new Draw(pl1[i], pl2[i], trigger1[trigIndex + 1], trigger2[trigIndex + 1], pad1[padInd + 1], pad2[padInd + 1]);
      drawValueList.Add(draw);

      if (draw.TriggerPressed0 == true || draw.TriggerPressed1 == true){
        triggeredList.Add(draw);
      }


      if ((draw.TouchPad0 == true || draw.TouchPad1 == true))
        touchClicked++;

      if (touchClicked > 5)
        touchClicked = 0;

      //}
    }

    // Call function to make a list with points at lease certain distance apart
    List<Draw> minDistanceList = pointsDistanceApart(triggeredList, minDistance);

    // Call function to make a list with Triggered point scaled
    // List<Pose> scaledPointsLists = pointsTriggerScaled(minDistanceList, scale);
    List<Draw> scaledPoints = new List<Draw>();
    if (Math.Abs(scale) > 1){
      for (int i = 0; i < triggeredList.Count; i++){
        Draw p = triggeredList[i];
        p.Plane0.Origin *= scale;
        p.Plane1.Origin *= scale;
        scaledPoints.Add(p);
      }
    }
    else{
      scaledPoints = minDistanceList;
    }

    // Call function to make a Brep surface of the circles perpendicular plane of the points
    //Brep[] circularLoft = circularLoftOnPerpPlane(scaledPoints, controllerSelector);

    List<Line> rightLine;
    List<Line> leftLine;
    var listTuple = makeLine(scaledPoints, lineNum);
    rightLine = listTuple.Item1; //line output from controller 0
    leftLine = listTuple.Item2;  //line output from controller 1

    switch (touchClicked)
    {
      case 1:
        List<Brep> betweenLoft = brepBetweenLists(rightLine, leftLine);
        lofts = betweenLoft;
        break;

      case 2:
        Brep[] circularLoft = circularLoftOnPerpPlane(scaledPoints, controllerSelector);
        lofts = circularLoft;
        break;

      case 3:
        Brep[] rectangularLoft = rectLoftOnPerpPlane(scaledPoints, controllerSelector);
        lofts = rectangularLoft;
        break;

      case 4:
        Brep[] triLoft = polyLoftOnPerpPlane(scaledPoints, 3, controllerSelector);
        lofts = triLoft;
        break;

      case 5:
        Brep[] pentaLoft = polyLoftOnPerpPlane(scaledPoints, 5, controllerSelector);
        lofts = pentaLoft;
        break;

      default:

        break;
    }


    // Output Geometry
    if(showLine == 1 || showLine == 3)
      rightLines = rightLine;
    if(showLine == 2 || showLine == 3)
      leftLines = leftLine;
    //lofts = circularLoft;
    draws = touchClicked;
    triggerOnly = minDistanceList;
# ---------- c_script_3: C# additional code ----------
  // FUNCTIONS

  //1: Create a list with points at least x distance apart
  public List<Draw> pointsDistanceApart(List<Draw> iList, double minDis){
    List<Draw> newList = new List<Draw>();

    for (int i = 0; i < iList.Count;i++){
      if(i == 0)
        newList.Add(iList[i]);
      else {
        double dis1 = iList[i].Plane0.Origin.DistanceTo(iList[i - 1].Plane0.Origin);
        double dis2 = iList[i].Plane1.Origin.DistanceTo(iList[i - 1].Plane1.Origin);
        if(dis1 > minDis || dis2 > minDis){
          newList.Add(iList[i]);
        }
      }
    }
    // return a new list with filtered points
    return newList;
  }

  // 2.0: Make a Line list of one or two lines with the input Pose list
  // n is the number of lines, inputed
  public Tuple<List<Line> ,List<Line>> makeLine(List<Draw> iList, int n){
    List<Line> line1 = new List<Line>(); // right controller line
    List<Line> line2 = new List<Line>(); // left controller line

    for(int i = 1;i < iList.Count;i++){
      if (iList[i - 1].TriggerPressed0 == true){ 
        Line a = new Line(iList[i - 1].Plane0.Origin, iList[i].Plane0.Origin);
        line1.Add(a);
      }
    }
    if(n == 2){
      for (int i = 1;i < iList.Count;i++){
        if (iList[i - 1].TriggerPressed1 == true){ 
          Line b = new Line(iList[i - 1].Plane1.Origin, iList[i].Plane1.Origin);
          line2.Add(b);
        }
      }
    }

    //Return a Tuple that contains two Line Lists
    return Tuple.Create(line1, line2);
  }

  // 3.0 Make a list of Breps of surfaces between the controllers
  public List<Brep> brepBetweenLists(List<Line> iLine1, List<Line> iLine2){
    List<Brep> oBreps = new List<Brep>();

    int smallerIndex;
    if (iLine1.Count < iLine2.Count){
      smallerIndex = iLine1.Count;
    }
    else{
      smallerIndex = iLine2.Count;
    }

    for (int i = 0; i < smallerIndex; i++) {
      List<NurbsCurve> pair = new List<NurbsCurve>();
      pair.Add(iLine1[i].ToNurbsCurve());
      pair.Add(iLine2[i].ToNurbsCurve());

      Brep[] loft = Brep.CreateFromLoft(pair, Point3d.Unset, Point3d.Unset, LoftType.Straight, false);
      oBreps.Add(loft[0]);
    }
    return oBreps;
  }

  // 4.0 Make a Brep loft of the circles on the prependicular plane of the points
  public Brep[] circularLoftOnPerpPlane(List<Draw> iPose, int controllerSelect){
    List<NurbsCurve> circles = new List<NurbsCurve>();

    if (controllerSelect == 1){
      for (int i = 0; i < iPose.Count; i++){
        Circle c1 = new Circle(iPose[i].PerpPlane1, iPose[i].Mag1);
        circles.Add(c1.ToNurbsCurve());
      }
    }
    else{
      for (int i = 0; i < iPose.Count; i++){
        Circle c1 = new Circle(iPose[i].PerpPlane0, iPose[i].Mag0);
        circles.Add(c1.ToNurbsCurve());
      }
    }
    Brep[] loftCircle = Brep.CreateFromLoft(circles, Point3d.Unset, Point3d.Unset, LoftType.Normal, true);

    return loftCircle;
  }

  // 4.1 Make a Brep loft of the rectangles on the prependicular plane of the points
  public Brep[] rectLoftOnPerpPlane(List<Draw> iPose, int controllerSelect){
    List<NurbsCurve> rects = new List<NurbsCurve>();
    if (controllerSelect == 1){
      for (int i = 0; i < iPose.Count; i++){
        Rectangle3d r1 = new Rectangle3d(iPose[i].PerpPlane1, iPose[i].Mag1, iPose[i].Mag1);
        rects.Add(r1.ToNurbsCurve());
      }
    }
    else{
      for (int i = 0; i < iPose.Count; i++){
        Rectangle3d r1 = new Rectangle3d(iPose[i].PerpPlane0, iPose[i].Mag0, iPose[i].Mag0);
        rects.Add(r1.ToNurbsCurve());
      }
    }
    Brep[] loftRect = Brep.CreateFromLoft(rects, Point3d.Unset, Point3d.Unset, LoftType.Normal, true);

    return loftRect;
  }

  // 4.2 Make a Brep loft of the polygons on the prependicular plane of the points
  public Brep[] polyLoftOnPerpPlane(List<Draw> iPose, int sides, int controllerSelect){
    List<Curve> pgons = new List<Curve>();
    Polyline p1 = new Polyline();

    if (controllerSelect == 1){
      for (int i = 0; i < iPose.Count; i++){
        if (iPose[i].Mag1 < 0.000001) {
          iPose[i].Mag1 = 0.01;
        }
        Circle c1 = new Circle(iPose[i].PerpPlane1, iPose[i].Mag1);
        p1 = Polyline.CreateInscribedPolygon(c1, sides);
        PolylineCurve p2 = new PolylineCurve(p1.ToPolylineCurve());
        pgons.Add(p2);

      }
    }
    else{
      for (int i = 0; i < iPose.Count; i++){
        if (iPose[i].Mag0 < 0.000001) {
          iPose[i].Mag0 = 0.01;
        }
        Circle c1 = new Circle(iPose[i].PerpPlane0, iPose[i].Mag0);
        p1 = Polyline.CreateInscribedPolygon(c1, sides);
        PolylineCurve p2 = new PolylineCurve(p1.ToPolylineCurve());
        pgons.Add(p2);
      }
    }
    Brep[] loftPoly = Brep.CreateFromLoft(pgons, Point3d.Unset, Point3d.Unset, LoftType.Normal, true);

    return loftPoly;
  }

  /* SCRAPED!!
  // 3.0 Make a Scaled list
  // if trigger was pressed, then scale it by factor x
  public List<Draw> pointsTriggerScaled(List<Draw> iList, double x){
    List<Draw> newList = new List<Draw>();

    for (int i = 0; i < iList.Count;i++){
      if(i == 0 || (!iList[i].TriggerPressed0 && !iList[i].TriggerPressed1))
        newList.Add(iList[i]);
      if (iList[i].TriggerPressed0 && Math.Abs(x) >= 1){
        Draw temp = iList[i];
        temp.Plane0.Origin *= x;
        newList.Add(temp);
      }
      else if(iList[i].TriggerPressed1 && Math.Abs(x) >= 1){
        Draw temp = iList[i];
        temp.Plane1.Origin *= x;
        newList.Add(temp);
      }
    }
    return newList;
  }*/

  //Custom Class
  public class Draw {
    public Plane Plane0;
    public Plane Plane1;
    public Plane PerpPlane0;
    public Plane PerpPlane1;

    public bool TriggerPressed0;
    public bool TriggerPressed1;
    public bool TouchPad0;
    public bool TouchPad1;

    public double Mag0;
    public double Mag1;

    public Draw(){
      Point3d pt = new Point3d(0, 0, 0);
      Vector3d xVect = new Vector3d(1, 0, 0);
      Vector3d yVect = new Vector3d(0, 1, 0);
      this.Plane0 = new Plane(pt, xVect);
      this.Plane1 = new Plane(pt, yVect);
      this.PerpPlane0 = new Plane(pt, yVect, this.Plane0.ZAxis);
      this.PerpPlane1 = new Plane(pt, yVect, this.Plane1.ZAxis);

      this.TriggerPressed0 = false;
      this.TriggerPressed1 = true;
      this.TouchPad0 = true;
      this.TouchPad1 = false;
      this.Mag0 = 1;
      this.Mag1 = 1;
    }

    public Draw(Plane pl0, Plane pl1, double click1, double click2, double touch1, double touch2){
      this.Plane0 = pl0;
      this.Plane1 = pl1;
      this.PerpPlane0 = new Plane(pl0.Origin, pl0.XAxis, pl0.ZAxis);
      this.PerpPlane1 = new Plane(pl1.Origin, pl1.XAxis, pl1.ZAxis);

      double possMag0 = pl0.Origin.X * pl0.Origin.Y * pl0.Origin.Z;
      double possMag1 = pl1.Origin.X * pl1.Origin.Y * pl1.Origin.Z;

      if(possMag0 < 0.5)
        possMag0 = 0.5;
      if(possMag1 < 0.5)
        possMag1 = 0.5;

      this.Mag0 = possMag0;
      this.Mag1 = possMag1;

      if(click1 == 0){
        this.TriggerPressed0 = false;
      }
      else{
        this.TriggerPressed0 = true;
      }
      if(click2 == 0){
        this.TriggerPressed1 = false;
      }
      else{
        this.TriggerPressed1 = true;
      }

      if(touch1 == 0){
        this.TouchPad0 = false;
      }
      else{
        this.TouchPad0 = true;
      }
      if(touch2 == 0){
        this.TouchPad1 = false;
      }
      else{
        this.TouchPad1 = true;
      }
    }


    public override string ToString() {
      return "Draw object at " + this.TriggerPressed0.ToString() + this.TriggerPressed1.ToString() + this.Plane0.Origin.ToString();
    }


  }
# ---------- end c_script_3 ----------
geo = Geometry(c_script_3.lofts)

# ---- group: CSV control parameters
use_local_folder = BooleanToggle(True)
save = Button()
panel_4 = Panel("BDE_01")

# ----
panel_5 = Panel(c_script_3.draws)
panel_6 = Panel(c_script_3.out)

# ---- group: CSV writer: double-click on the C# component to look through the code
save_captured_data = CSharpScript(
    name=panel_4,
    useLocalFolder=Toggle(False),
    save=save,
    timestamp=bang.Branch0,
    pl1=bang.Branch1,
    trigger1=bang.Branch2,
    pad1=bang.Branch3,
    pl2=bang.Branch4,
    trigger2=bang.Branch5,
    pad2=bang.Branch6)  # -> out, CSV; inputs name: String, useLocalFolder: Boolean, save: Boolean, timestamp: list of String, pl1: list of Plane, trigger1: list of Double, pad1: list of Double, pl2: list of Plane, trigger2: list of Double, pad2: list of Double
# ---------- save_captured_data: C# usings ----------
using System.IO;
using System.Linq;
using System.Data;
using System.Drawing;
using System.Reflection;
using System.Windows.Forms;
using System.Xml;
using System.Xml.Linq;
using System.Runtime.InteropServices;

using Rhino.DocObjects;
using Rhino.Collections;
using GH_IO;
using GH_IO.Serialization;
# ---------- save_captured_data: C# ----------
    int frames = pl1.Count;
    List<string> data = new List<string>();
    for(int i = 0; i < frames; i++){
      // Get indexes for the trigger and pad lists
      int trigIndex = i * 3;
      int padInd = i * 4;

      // Parse the data from the first controller into strings using the custom functions below
      string plane1 = ParsePlane(pl1[i]);
      string trig1 = ParseTrigger(trigger1[trigIndex], trigger1[trigIndex + 1], trigger1[trigIndex + 2]);
      string padS1 = ParsePad(pad1[padInd], pad1[padInd + 1], pad1[padInd + 2], pad1[padInd + 3]);

      // Parse the data from the second controller into strings
      string plane2 = ParsePlane(pl2[i]);
      string trig2 = ParseTrigger(trigger2[trigIndex], trigger2[trigIndex + 1], trigger2[trigIndex + 2]);
      string padS2 = ParsePad(pad2[padInd], pad2[padInd + 1], pad2[padInd + 2], pad2[padInd + 3]);

      // Combine all strings into one line
      string line = timestamp[i] + "," + plane1 + trig1 + padS1 + plane2 + trig2 + padS2;

      // Store that line in the list of strings
      data.Add(line);
    }

    // Convert the list of strings into a single string with new lines between each row
    // This isn't strictly necessary, you can add the new line in the previous for loop
    // I just liked creating the csv row by row
    string csv = ShortHeaders();
    for(int i = 0; i < data.Count; i++){
      csv = csv + data[i] + "\n";
    }

    // Figure out folder to save this file: along this GH file's path, or your system's Desktop folder
    string targetFolder = "";
    if (useLocalFolder) {
      // https://www.grasshopper3d.com/forum/topics/get-location-of-current-grasshopper-file
      GH_Document gh_d = owner.OnPingDocument();
      if (gh_d.IsFilePathDefined)
      {
        // Figure out the path of this GH file.
        string ghFilePath = gh_d.FilePath;
        // Remove the filename from it
        targetFolder = Path.GetDirectoryName(ghFilePath);
      }
      else
      {
        Print("No local folder found, please save your file locally.");
      }
    }
      // Otherwise, use the Desktop folder
    else {
      // First, we need to figure out the path to your Desktop:
      targetFolder = Environment.GetFolderPath(Environment.SpecialFolder.Desktop);
    }

    // Add the name of the file to the destination folder
    string filepath = Path.Combine(targetFolder, name + ".csv");
    Print("Destination file: " + filepath);

    // Save out the file when ready!
    /* if (save == true){
    File.WriteAllText(filepath, csv);
    Print("File " + filepath + " has been saved!");
    }
    */
    CSV = csv;
# ---------- save_captured_data: C# additional code ----------
  static string ParsePlane(Plane pl){
    // This function converts the information held in a Plane into a string (without the extra text that GH includes)

    // Decompose the plane into its component parts
    Point3d origin = pl.Origin;
    Vector3d xAxis = pl.XAxis;
    Vector3d yAxis = pl.YAxis;

    // Use the builin ToString method to convert the Point/Vector data into strings
    string full = origin.ToString() + "," + xAxis.ToString() + "," + yAxis.ToString() + ",";

    return full;
  }

  static string ParseTrigger(double press, double click, double val){
    // This function takes the trigger values which come in as a list of doubles, and replaces the 0/1 with false/true
    // And then concatenates into one string

    // Declare output and then start filling it with the trigger press values
    string output;
    if(press == 0){
      output = "false,";
    }
    else{
      output = "true,";
    }
    if(click == 0){
      output = output + "false,";
    }
    else{
      output = output + "true,";
    }
    // The value of the trigger is already a double, so we just convert to string and add it to the end
    output = output + val.ToString() + ",";

    return output;
  }

  static string ParsePad(double press, double click, double xVal, double yVal){
    // This function takes the touch pad values which come in as a list of doubles, and replaces the 0/1 with false/true
    // And then concatenates into one string

    // Declare output and then start filling it with the trigger press values
    string output;
    if(press == 0){
      output = "false,";
    }
    else{
      output = "true,";
    }
    if(click == 0){
      output = output + "false,";
    }
    else{
      output = output + "true,";
    }
    // The values of the x and y dimensions of the touch pad are already doubles, so we just concatenate as before
    output = output + xVal.ToString() + "," + yVal.ToString() + ",";

    return output;

  }

  static string ShortHeaders() {
    string headers =
      "TIMESTAMP," +
      "T0_ORIGIN_X,T0_ORIGIN_Y,T0_ORIGIN_Z,T0_XAXIS_X,T0_XAXIS_Y,T0_XAXIS_Z,T0_YAXIS_X,T0_YAXIS_Y,T0_YAXIS_Z," +
      "T0_TRIGGER_PRESSED,T0_TRIGGER_CLICKED,T0_TRIGGER_VALUE,T0_TOUCHPAD_PRESSED,T0_TOUCHPAD_CLICKED,T0_TOUCHPAD_VALUE_X,T0_TOUCHPAD_VALUE_Y," +
      "T1_ORIGIN_X,T1_ORIGIN_Y,T1_ORIGIN_Z,T1_XAXIS_X,T1_XAXIS_Y,T1_XAXIS_Z,T1_YAXIS_X,T1_YAXIS_Y,T1_YAXIS_Z," +
      "T1_TRIGGER_PRESSED,T1_TRIGGER_CLICKED,T1_TRIGGER_VALUE,T1_TOUCHPAD_PRESSED,T1_TOUCHPAD_CLICKED,T1_TOUCHPAD_VALUE_X,T1_TOUCHPAD_VALUE_Y" +
      "\n";


    return headers;
  }
# ---------- end save_captured_data ----------
panel_7 = Panel(save_captured_data.out)

# ----
panel_8 = Panel(save_captured_data.CSV)
